# Dynamo custom node Config.Read.dyf (Dynamo 1.0.0.1180)
# category: DynamoAutomation.Config.Query
# Reads a configuration file at a given filepath. Items in the config file need to be separated by line breaks. Expected format for each item is key=value

filepath = Input(filepath : string)
fromPath = FileObject(filepath)  # "File.FromPath"
readText = File.ReadText(fromPath)
string = StringInput("\n")
split = String.Split(readText, string)
string_2 = StringInput("#")
startsWith = String.StartsWith(str=split, searchFor=string_2)
filterByBoolMask = List.FilterByBoolMask(list=split, mask=startsWith)
string_3 = StringInput("=")
split_2 = String.Split(filterByBoolMask.out, string_3)
transpose = List.Transpose(split_2)
trimWhitespace = String.TrimWhitespace(transpose)
code_block = CodeBlock(seq=trimWhitespace)
# ---------- code_block.designscript (4 lines) ----------
// Keys
seq[0];
// Values
seq[1];
# ----------------------------------------
configKeys = Input(configKeys : string[]..[])
firstIndexOf = List.FirstIndexOf(list=code_block.out0, item=configKeys)
getItemAtIndex = List.GetItemAtIndex(list=code_block.out1, index=firstIndexOf)
values = Output(getItemAtIndex)
