# Dynamo custom node Journal.RevitStartupArguments.dyf (Dynamo 1.0.0.1180)
# category: DynamoAutomation.Journal.Create
# Creates startup arguments for Revit

journalPath = Input(journalPath : string)
disableSplashScreen = Input(disableSplashScreen : bool = true)
string = StringInput(" /nosplash")
string_2 = StringInput("")
if_ = If(test=disableSplashScreen, true=string, false=string_2)
code_block = CodeBlock(jpath=journalPath, nosplash=if_) { " /language ENU " + jpath + nosplash; }
args = Output(code_block)
