# Dynamo custom node RevitAddinsPath.ByVersion.dyf (Dynamo 1.3.1.1736)
# category: DynamoAutomation.FilePath.Create
# Returns the path of Revit Addins folder based on a given Revit version

string = StringInput("C:\ProgramData\Autodesk\Revit\Addins\")
revitVersion = Input(revitVersion : string = "2018")
code_block = CodeBlock(basepath=string, RevitVersion=revitVersion) { basepath + RevitVersion; }
revitAddinsDirectoryPath = Output(code_block)
