# Dynamo custom node ExternalApplication.Run.dyf (Dynamo 0.8.1.1473)
# category: DynamoAutomation
# Launches a given external application with the given arguments

Executable_Path = Input()
Arguments = Input()
python_script = Python(IN[0]=Executable_Path, IN[1]=Arguments)
# ---------- python_script.python (12 lines) ----------
from System.Diagnostics import Process

command = IN[0]
args = IN[1]

proc = Process()
proc.StartInfo.FileName = command
proc.StartInfo.Arguments = args
proc.Start()
proc.WaitForExit()

OUT = True
# ----------------------------------------
Output = Output(python_script)  # ""
