# Dynamo custom node RevitJournalFile.ByPaths2.dyf (Dynamo 0.8.1.1473)
# category: DynamoAutomation
# Creates a Revit journal file that starts Revit with a given project/family and launches the Dynamo addin with a given Dynamo graph.

string = StringInput("Dim Jrn\nSet Jrn = CrsJournalScript \nJrn.Command \"StartupPage\" , \"Open this project , ID_FILE_MRU_FIRST\" \nJrn.Data \"MRUFileName\"  , \"{0}\" \nJrn.RibbonEvent \"Execute external command:CustomCtrl_%CustomCtrl_%Add-Ins%Visual Programming%Dynamo {1}:Dynamo.Applications.DynamoRevit\"\nJrn.Data \"APIStringStringMapJournalData\", 1, \"dynFile\", \"{2}\"\nJrn.Command \"Internal\" , \"Flush undo and redo stacks , ID_FLUSH_UNDO\" \nJrn.Command \"SystemMenu\" , \"Quit the application, prompts to save projects , ID_APP_EXIT\"")
Revit_File = Input()
Dynamo_Version = Input()
Dynamo_File = Input()
Journal_Directory = Input()
string_2 = StringInput("\")
Journal_File_Name = Input()
code_block = CodeBlock(jtext1=string, revit_file=Revit_File, dynversion=Dynamo_Version, dyn_file=Dynamo_File, jdir=Journal_Directory, delimeter=string_2, jfile=Journal_File_Name)
# ---------- code_block.designscript (7 lines) ----------
// Replace placeholders in journal file text
jtext2 = String.Replace(jtext1,"{0}",revit_file);
// The Dynamo version should be queryable through DesignScript - ToDo for Ian
jtext3 = String.Replace(jtext2,"{1}",dynversion ? "0.8" : "0.7");
jtext4 = String.Replace(jtext3,"{2}",dyn_file);
// Create file name for journal file
jdir + delimeter + jfile + ".txt";
# ----------------------------------------
writeText = File.WriteText(code_block.out3, code_block.jtext4)
Journal_File_Path = Output(code_block.out3)
