# Dynamo graph Sandbox - Launch Revit with Dynamo - via Dynamo Button.dyn (Dynamo 0.8.1.1473)

revit_version = StringInput("2015")
byVersion = Custom[RevitExecutablePath.ByVersion](RevitVersion=revit_version)  # Returns the path of Revit.exe based on a given Revit version
file_path_revit_file = Filename("C:\Program Files\Autodesk\Revit 2015\Samples\rac_basic_sample_project.rvt")
file_path_dynamo_file = Filename("C:\Users\adieckmann\Desktop\FamParam.dyn")
directory_path_journal_file = Directory("C:\Users\adieckmann\Desktop")
file_name_journal_file = StringInput("DynamoAutomationTestJournal")
dynamo_version_0_8_0_7 = BoolSelector(false)
byPaths2 = Custom[RevitJournalFile.ByPaths2](Revit_File=file_path_revit_file, Dynamo_File=file_path_dynamo_file, Journal_Directory=directory_path_journal_file, Journal_File_Name=file_name_journal_file, Dynamo_Version=dynamo_version_0_8_0_7)  # Creates a Revit journal file that starts Revit with a given project/family and launches the Dynamo addin with a given Dynamo graph.
code_block = CodeBlock(jfile=byPaths2) { "\"" + jfile + "\""; }
# note: Result: "Error on opening document"
# (This is referring to the Revit project file...)
# ... and Revit exits.
run = Custom[ExternalApplication.Run](Executable_Path=byVersion, Arguments=code_block)  # Launches a given external application with the given arguments
