# Dynamo graph Sandbox - Launch Revit with Dynamo.dyn (Dynamo 0.8.1.1473)

revit_version = StringInput("2016")
byVersion = Custom[RevitExecutablePath.ByVersion](RevitVersion=revit_version)  # Returns the path of Revit.exe based on a given Revit version
file_path_revit_file = Filename("C:\Users\adieckmann\Desktop\Regale.rvt")
file_path_dynamo_file = Filename("C:\Users\adieckmann\Desktop\FamParam.dyn")
directory_path_journal_file = Directory("C:\Users\adieckmann\Desktop")
file_name_journal_file = StringInput("DynamoAutomationTestJournal")
byPaths = Custom[RevitJournalFile.ByPaths](Revit_File=file_path_revit_file, Dynamo_File=file_path_dynamo_file, Journal_Directory=directory_path_journal_file, Journal_File_Name=file_name_journal_file)  # Creates a Revit journal file that starts Revit with a given project/family and launches the Dynamo addin with a given Dynamo graph.
run = Custom[ExternalApplication.Run](Executable_Path=byVersion, Arguments=byPaths)  # Launches a given external application with the given arguments
