# Dynamo graph Slave1_AlterFamily.dyn (Dynamo 0.8.3.2580)

element_types = ElementTypes("ModelText")
all_elements_of_type = ElementsOfType(element_types)
text = Custom[TextElement.Text](element=all_elements_of_type)  # Gets the text stored in a text element (i.e. text note or model text)
code_block = CodeBlock(txt=text) { txt + "\nand Dynamo just \naltered it..."; }
setText = Custom[TextElement.SetText](element=all_elements_of_type, text=code_block)  # Sets the text of a given text element (i.e. text note or model text)
path = Custom[Document.Path]()  # Gets the path and directory of the current Revit document
code_block_2 = CodeBlock { ".rfa"; "_altered.rfa"; }
replace = String.Replace(str=path.path, searchFor=code_block_2.out0, replaceWith=code_block_2.out1)
code_block_3 = CodeBlock(a=setText.success, b=replace) { {a,b}[1]; }
end = Revit.Transaction.Transaction.End(code_block_3)
saveAs = Custom[Document.SaveAs](filePath=end)  # Saves the active Revit document under the given name.
