# Dynamo graph Slave2_LoadAndPlaceFamilies.dyn (Dynamo 0.8.3.2580)

directory_path = Directory("C:\temp\DynamoAutomation\rtc_teaser")
fromPath = DirectoryObject(directory_path)  # "Directory.FromPath"
code_block = CodeBlock { "*altered.rfa"; }
contents = Directory.Contents(fromPath, code_block)
loadFamily = Custom[Document.LoadFamily](path=contents)  # A very crude implementation of family loading. Will *not* reload an already loaded family of the same name.
flatten = Flatten(loadFamily)
code_block_2 = CodeBlock { 0..4000..#3; }
byCoordinates = FamilyInstance.ByCoordinates(flatten, code_block_2)
path = Custom[Document.Path]()  # Gets the path and directory of the current Revit document
code_block_3 = CodeBlock { ".rvt"; "_altered.rvt"; }
replace = String.Replace(str=path.path, searchFor=code_block_3.out0, replaceWith=code_block_3.out1)
code_block_4 = CodeBlock(passthrough=byCoordinates, path=replace) { {passthrough,path}[1]; }
end = Revit.Transaction.Transaction.End(code_block_4)
saveAs = Custom[Document.SaveAs](filePath=end)  # Saves the active Revit document under the given name.
