# Dynamo custom node ExternalApplication.Run.dyf (Dynamo 0.8.1.1473)
# category: DynamoAutomation
# Launches a given external application with the given arguments

ExecutablePath = Input(ExecutablePath : string)
Arguments = Input(Arguments : string = "")
code_block = CodeBlock(args=Arguments) { "\"" + args + "\""; }
python_script = Python(IN[0]=ExecutablePath, IN[1]=code_block)
# ---------- python_script.python (12 lines) ----------
from System.Diagnostics import Process

command = IN[0]
args = IN[1]

proc = Process()
proc.StartInfo.FileName = command
proc.StartInfo.Arguments = args
proc.Start()
proc.WaitForExit()

OUT = True
# ----------------------------------------
Output = Output(python_script)  # ""
