# Dynamo custom node Config.GetPath.dyf (Dynamo 1.3.1.1736)
# category: DynamoAutomation.Config.Query
# Adds a root directory to a given path. If the given path is an absolute path, the root directory is not added.

path = Input()
string = StringInput(":\")
contains = String.Contains(str=path, searchFor=string)
rootdir = Input()
code_block = CodeBlock(rootdir=rootdir, path=path) { rootdir + "\\" + path; }
if_ = If(test=contains, true=path, false=code_block)
fullPath = Output(if_)
