# Dynamo custom node JournalFile.ExtractAPIErrors.dyf (Dynamo 1.0.0.1180)
# category: DynamoAutomation.Journal.Query
# Extracts all API errors from a Revit journal file

file = Input(file : System.IO.FileInfo)
readText = File.ReadText(file)
string = StringInput("\n")
split = String.Split(readText, string)
string_2 = StringInput("API_ERROR")
contains = String.Contains(str=split, searchFor=string_2)
filterByBoolMask = List.FilterByBoolMask(list=split, mask=contains)
string_3 = StringInput("{")
split_2 = String.Split(filterByBoolMask.in, string_3)
transpose = List.Transpose(split_2)
lastItem = List.LastItem(transpose)
trimWhitespace = String.TrimWhitespace(lastItem)
code_block = CodeBlock { -1; 1; }
remove = String.Remove(str=trimWhitespace, startIndex=code_block.out0, count=code_block.out1)
trimWhitespace_2 = String.TrimWhitespace(remove)
error = Output(trimWhitespace_2)
getKeys = GetKeys(split)
filterByBoolMask_2 = List.FilterByBoolMask(list=getKeys, mask=contains)
line = Output(filterByBoolMask_2.in)
