# Dynamo custom node JournalFile.ExtractCommands.dyf (Dynamo 1.0.0.1180)
# category: DynamoAutomation.Journal.Query
# Extracts all commands from a journal file

file = Input(file : System.IO.FileInfo)
readText = File.ReadText(file)
string = StringInput("\n")
split = String.Split(readText, string)
trimWhitespace = String.TrimWhitespace(split)
string_2 = StringInput("Jrn.Command")
startsWith = String.StartsWith(str=trimWhitespace, searchFor=string_2)
filterByBoolMask = List.FilterByBoolMask(list=trimWhitespace, mask=startsWith)
string_3 = StringInput("\"")
split_2 = String.Split(filterByBoolMask.in, string_3)
transpose = List.Transpose(split_2)
code_block = CodeBlock(seq=transpose) { seq[1]; seq[3]; }
string_4 = StringInput(" , ")
split_3 = String.Split(code_block.out1, string_4)
reverse = List.Reverse()
map = List.Map(list=split_3, f_x=reverse)
transpose_2 = List.Transpose(map)
firstItem = List.FirstItem(transpose_2)
ID = Output(firstItem)
lastItem = List.LastItem(transpose_2)
Description = Output(lastItem)
Type = Output(code_block.out0)
