# Dynamo custom node JournalFiles.Cleanup.dyf (Dynamo 1.0.0.1180)
# category: DynamoAutomation.Journal.Actions
# Moves all journal files created during a batch-processing operation to a specified directory

generatedJournalFiles = Input(generatedJournalFiles : string[])
directoryName = FilePath.DirectoryName(generatedJournalFiles)
firstItem = List.FirstItem(directoryName)
fromPath = DirectoryObject(firstItem)  # "Directory.FromPath"
contents = Directory.Contents(fromPath)
string = StringInput("journal.[0-9]+.txt")
matchRegularExpression = Custom[String.MatchRegularExpression](RegEx=string, str=contents)  # Determines if a regular expression matches a string (or a list of strings) and returns a boolean value (or a list, depending on the input). The syntax for regular expressions is explained at http://ironpython-test.readthedocs.org/en/latest/howto/regex.html
filterByBoolMask = List.FilterByBoolMask(list=contents, mask=matchRegularExpression)
string_2 = StringInput("dump.[0-9]+.txt")
matchRegularExpression_2 = Custom[String.MatchRegularExpression](RegEx=string_2, str=contents)
filterByBoolMask_2 = List.FilterByBoolMask(list=contents, mask=matchRegularExpression_2)
string_3 = StringInput("journal.[0-9]+.[0-9]+.dmp")
matchRegularExpression_3 = Custom[String.MatchRegularExpression](RegEx=string_3, str=contents)
filterByBoolMask_3 = List.FilterByBoolMask(list=contents, mask=matchRegularExpression_3)
join = List.Join(generatedJournalFiles, filterByBoolMask.in, filterByBoolMask_2.in, filterByBoolMask_3.in)
uniqueItems = List.UniqueItems(join)
executionDone = Input()
passthrough = Custom[Passthrough](passThrough=uniqueItems, waitFor=executionDone)  # Forces a sequential order of execution. The node wired into the output of the Passthrough node will be executed *after* the node wired into the waitFor input (e.g. important for some Revit operations). The value of the passThrough input will be passed on to the node wired into the output port of the Passthrough node.
destinationDirectory = Input(destinationDirectory : string)
replace = String.Replace(str=uniqueItems, searchFor=firstItem, replaceWith=destinationDirectory)
overwriteExistingFiles = Input(overwriteExistingFiles : bool = true)
move = File.Move(passthrough, replace, overwriteExistingFiles)
Output = Output(move)  # ""
