# Dynamo custom node Regex.ContainsRegularExpression.dyf (Dynamo 1.3.1.1736)
# category: Clockwork.Core.String.Actions
# Determines if a regular expression matches a string (or a list of strings), i.e. occurs anywhere in the string, and returns a boolean value (or a list, depending on the input). The syntax for regular expressions is explained at
# http://ironpython-test.readthedocs.org/en/latest/howto/regex.html

RegEx = Input(RegEx : string)
ignoreCase = Input(ignoreCase : bool = false)  # Perform case-insensitive matching
useLocale = Input(useLocale : bool = false)  # Treat special characters (e.g. 'ü') from the currently set system locale as letters
dotAll = Input(dotAll : bool = false)  # Make . match any character, including newlines
multilineMatching = Input(multilineMatching : bool = false)  # ^ matches at the beginning of each line, $ matches at the end of each line
compileRegularExpression = Custom[Regex.CompileRegularExpression](regExp=RegEx, ignoreCase=ignoreCase, useLocale=useLocale, dotAll=dotAll, multilineMatching=multilineMatching)  # "String.CompileRegularExpression"; This is a helper node for setting certain flags for the Regular Expresssion nodes. http://ironpython-test.readthedocs.org/en/latest/howto/regex.html
str = Input(str : string)
python_script = Python(IN[0]=compileRegularExpression, IN[1]=str)
# ---------- python_script.python (9 lines) ----------
import clr
import re

def ContainsRegex(regex, str):
	if regex.search(str): return True
	else: return False

if isinstance(IN[1], list): OUT = [ContainsRegex(IN[0], x) for x in IN[1]]
else: OUT = ContainsRegex(IN[0], IN[1])
# ----------------------------------------
bool = Output(python_script)
