# Dynamo graph A3 - Sandbox.dyn (Dynamo 0.8.3.2535)

# group: INPUTS
directory_path_journal_files = Directory("C:\Users\adieckmann\Desktop")
overwrite_existing_journal_files = BoolSelector(true)
file_path_csv_file_of_directory = Filename("C:\Users\adieckmann\Documents\GitHub\DynamoAutomation\scenarios\A3\File Paths.txt")  # "File Path (CSV File of Directory Paths)"
file_path_dynamo_file = Filename("C:\Users\adieckmann\Documents\GitHub\DynamoAutomation\scenarios\Revit\2016\CountWalls.dyn")
revit_version = StringInput("2016")

# group: Create list of Revit files
fromPath = FileObject(file_path_csv_file_of_directory)  # "File.FromPath"
readFromFile = CSV.ReadFromFile(fromPath)
flatten = Flatten(readFromFile)
exists = File.Exists(flatten)
filterByBoolMask = List.FilterByBoolMask(list=flatten, mask=exists)

# group: Create journal files
byVersion = Custom[RevitAddinsPath.ByVersion](RevitVersion=revit_version)  # Returns the path of Revit Addins folder based on a given Revit version
string = StringInput("\")
count = List.Count(filterByBoolMask.in)
code_block = CodeBlock(n=count) { 1..n; }
string_from_object = FromObject(code_block)
code_block_2 = CodeBlock(jdir=byVersion, delimiter=string, n=string_from_object)
# ---------- code_block_2.designscript (2 lines) ----------
// Create file name for journal file
jdir + delimiter + "DynamoJournalFile_" + n + ".txt";
# ----------------------------------------
byWorkspacePath = Dynamo.Automation.Journal.ByWorkspacePath(filterByBoolMask.in, file_path_dynamo_file, code_block_2)

# group: Batch-process Revit files
code_block_3 = CodeBlock(jpath=byWorkspacePath)
# ---------- code_block_3.designscript (7 lines) ----------
// You'll need an English language version of Revit
// in order to run the journals.
// If that is your default language
// you won't need this code block.
// This is what needs to appended to the exectuable path for Revit 2016.
// It may be different for Revit 2015.
" /language ENU " + jpath;
# ----------------------------------------
byVersion_2 = Custom[RevitExecutablePath.ByVersion](RevitVersion=revit_version)  # Returns the path of Revit.exe based on a given Revit version
byPathAndArguments = Dynamo.Automation.Process.ByPathAndArguments(byVersion_2)
map = List.Map(list=code_block_3, f_x=byPathAndArguments)
cleanup = Custom[JournalFiles.Cleanup](destinationDirectory=directory_path_journal_files, overwriteExistingFiles=overwrite_existing_journal_files, executionDone=map, generatedJournalFiles=byWorkspacePath)  # Moves all journal files created during a batch-processing operation to a specified directory
