# Dynamo graph B - Sandbox.dyn (Dynamo 0.8.3.2580)

# group: INPUTS
directory_path_journal_files = Directory("C:\temp\DynamoAutomation\output")
overwrite_existing_journal_files = BoolSelector(true)
revit_version = StringInput("2016")
file_path_dynamo_file_1 = Filename("C:\temp\DynamoAutomation\slave_graphs\Revit2016\ExtractLinkedModels.dyn")

file_path_revit_file = Filename("C:\temp\DynamoAutomation\revit_models\2016\MasterModel.rvt")

# group: Create journal file
byVersion = Custom[RevitAddinsPath.ByVersion](RevitVersion=revit_version)  # Returns the path of Revit Addins folder based on a given Revit version
code_block = CodeBlock(jdir=byVersion)
# ---------- code_block.designscript (2 lines) ----------
// Create file name for journal file
jdir + "\\DynamoJournalFile_Master.txt";
# ----------------------------------------
byWorkspacePath = Dynamo.Automation.Journal.ByWorkspacePath(file_path_revit_file, file_path_dynamo_file_1, code_block)

# group: Batch-process Revit files
byVersion_2 = Custom[RevitExecutablePath.ByVersion](RevitVersion=revit_version)  # Returns the path of Revit.exe based on a given Revit version
code_block_2 = CodeBlock(jpath=byWorkspacePath)
# ---------- code_block_2.designscript (7 lines) ----------
// You'll need an English language version of Revit
// in order to run the journals.
// If that is your default language
// you won't need this code block.
// This is what needs to appended to the exectuable path for Revit 2016.
// It may be different for Revit 2015.
" /language ENU " + jpath;
# ----------------------------------------
byPathAndArguments = Dynamo.Automation.Process.ByPathAndArguments(byVersion_2, code_block_2)

# group: Create list of linked models
code_block_3 = CodeBlock(dir=directory_path_journal_files, done=byPathAndArguments)
# ---------- code_block_3.designscript (3 lines) ----------
linksPath = dir + "\\LinkedFiles.CSV";
// Make sure that the links have already been extracted
{linksPath,done}[0];
# ----------------------------------------
fromPath = FileObject(code_block_3.out1)  # "File.FromPath"
readFromFile = CSV.ReadFromFile(fromPath)
flatten = Flatten(readFromFile)

file_path_dynamo_file_2 = Filename("C:\temp\DynamoAutomation\slave_graphs\Revit2016\CountWalls.dyn")

# group: Create journal file
byVersion_3 = Custom[RevitAddinsPath.ByVersion](RevitVersion=revit_version)
count = List.Count(flatten)
code_block_4 = CodeBlock(n=count) { 1..n; }
string_from_object = FromObject(code_block_4)
code_block_5 = CodeBlock(jdir=byVersion_3, n=string_from_object)
# ---------- code_block_5.designscript (2 lines) ----------
// Create file name for journal file
jdir + "\\DynamoJournalFile_" + n + ".txt";
# ----------------------------------------
byWorkspacePath_2 = Dynamo.Automation.Journal.ByWorkspacePath(flatten, file_path_dynamo_file_2, code_block_5)

# group: Batch-process Revit files
byVersion_4 = Custom[RevitExecutablePath.ByVersion](RevitVersion=revit_version)
code_block_6 = CodeBlock(jpath=byWorkspacePath_2)  # same code as code_block_2
byPathAndArguments_2 = Dynamo.Automation.Process.ByPathAndArguments(byVersion_4, code_block_6)
join = List.Join(byWorkspacePath, byWorkspacePath_2)
cleanup = Custom[JournalFiles.Cleanup](destinationDirectory=directory_path_journal_files, overwriteExistingFiles=overwrite_existing_journal_files, executionDone=byPathAndArguments_2, generatedJournalFiles=join)  # Moves all journal files created during a batch-processing operation to a specified directory
