# Dynamo graph ExtractLinkedModels_R2016.dyn (Dynamo 0.8.3.2580)

# group: INPUTS
directory_path = Directory("C:\temp\DynamoAutomation\output")
report_csv_file_name = StringInput("LinkedFiles")

# group: Collect data from model
get_documents = Custom[Get Documents]()  # Queries all linked Revit files and retrieves their Name, LinkInstance and Document properties.

# group: Write data to CSV file
string = StringInput("\")
code_block = CodeBlock(dir=directory_path, delimiter=string, csvname=report_csv_file_name) { dir + delimiter + csvname + ".CSV"; }
writeToFile = CSV.WriteToFile(code_block, get_documents.Link_Path)
