# Dynamo graph CountWindows.dyn (Dynamo 0.8.3.2580)

# group: INPUTS
directory_path_csv_file = Directory("C:\temp\DynamoAutomation\output")

# group: Collect data from CSV file
code_block = CodeBlock(dir=directory_path_csv_file) { dir + "\AutomatedReport.CSV"; }
fromPath = FileObject(code_block)  # "File.FromPath"
readFromFile = CSV.ReadFromFile(fromPath)

# group: Collect data from model
path = Custom[Document.Path]()  # Gets the path and directory of the current Revit document
categories = Categories("Windows")
all_elements_of_category = ElementsOfCategory(categories)
count = List.Count(all_elements_of_category)
now = DateTime.Now()
code_block_2 = CodeBlock(path=path.path, count=count, now=now) { {{path,count,"CountWindows.dyn",now}}; }

# group: Append collected data to CSV file
join = List.Join(readFromFile, code_block_2)
writeToFile = CSV.WriteToFile(code_block, join)
