# Dynamo graph ExtractLinkedModels.dyn (Dynamo 0.8.3.2580)

directory_path = Directory("C:\temp\DynamoAutomation\output")
code_block = CodeBlock(dir=directory_path) { dir + "\\LinkedFiles.CSV"; }
get_documents = Custom[Get Documents]()  # Queries all linked Revit files and retrieves their Name, LinkInstance and Document properties.
writeToFile = CSV.WriteToFile(code_block, get_documents.Link_Path)
