# Dynamo graph ExtractTagFamilies.dyn (Dynamo 0.8.3.2580)

categories = Categories("AreaLoadTags")
categories_2 = Categories("AreaReinTags")
categories_3 = Categories("AreaTags")
categories_4 = Categories("AssemblyTags")
categories_5 = Categories("BeamAnalyticalTags")
categories_6 = Categories("BeamSystemTags")
categories_7 = Categories("BraceAnalyticalTags")
categories_8 = Categories("CableTrayFittingTags")
categories_9 = Categories("CableTrayTags")
categories_10 = Categories("CaseworkTags")
categories_11 = Categories("CeilingTags")
categories_12 = Categories("ColumnAnalyticalTags")
categories_13 = Categories("CommunicationDeviceTags")
categories_14 = Categories("ConduitTags")
categories_15 = Categories("CurtaSystemTags")
categories_16 = Categories("CurtainWallPanelTags")
categories_17 = Categories("DataDeviceTags")
categories_18 = Categories("DetailComponentTags")
categories_19 = Categories("DoorTags")
categories_20 = Categories("DuctAccessoryTags")
categories_21 = Categories("DuctFittingTags")
categories_22 = Categories("DuctInsulationsTags")
categories_23 = Categories("DuctLiningsTags")
categories_24 = Categories("DuctTags")
categories_25 = Categories("DuctTerminalTags")
categories_26 = Categories("ElectricalEquipmentTags")
categories_27 = Categories("ElectricalFixtureTags")
categories_28 = Categories("FabricReinforcementTags")
categories_29 = Categories("FabricationPartTags")
categories_30 = Categories("FireAlarmDeviceTags")
categories_31 = Categories("FlexDuctTags")
categories_32 = Categories("FlexPipeTags")
categories_33 = Categories("FloorAnalyticalTags")
categories_34 = Categories("FloorTags")
categories_35 = Categories("FoundationSlabAnalyticalTags")
categories_36 = Categories("FurnitureSystemTags")
categories_37 = Categories("FurnitureTags")
categories_38 = Categories("GenericModelTags")
categories_39 = Categories("InternalAreaLoadTags")
categories_40 = Categories("InternalLineLoadTags")
categories_41 = Categories("InternalPointLoadTags")
categories_42 = Categories("IsolatedFoundationAnalyticalTags")
categories_43 = Categories("KeynoteTags")
categories_44 = Categories("LightingDeviceTags")
categories_45 = Categories("LightingFixtureTags")
categories_46 = Categories("LineLoadTags")
categories_47 = Categories("LinkAnalyticalTags")
categories_48 = Categories("MEPSpaceTags")
categories_49 = Categories("MassAreaFaceTags")
categories_50 = Categories("MassTags")
categories_51 = Categories("MaterialTags")
categories_52 = Categories("MechanicalEquipmentTags")
categories_53 = Categories("MultiCategoryTags")
categories_54 = Categories("NodeAnalyticalTags")
categories_55 = Categories("NurseCallDeviceTags")
categories_56 = Categories("ParkingTags")
categories_57 = Categories("PartTags")
categories_58 = Categories("PathReinTags")
categories_59 = Categories("PipeAccessoryTags")
categories_60 = Categories("PipeFittingTags")
categories_61 = Categories("PipeInsulationsTags")
categories_62 = Categories("PipeTags")
categories_63 = Categories("PlantingTags")
categories_64 = Categories("PlumbingFixtureTags")
categories_65 = Categories("PointLoadTags")
categories_66 = Categories("RebarTags")
categories_67 = Categories("RevisionCloudTags")
categories_68 = Categories("RoofTags")
categories_69 = Categories("RoomTags")
categories_70 = Categories("SecurityDeviceTags")
categories_71 = Categories("SitePropertyLineSegmentTags")
categories_72 = Categories("SitePropertyTags")
categories_73 = Categories("SiteTags")
categories_74 = Categories("SpecialityEquipmentTags")
categories_75 = Categories("SprinklerTags")
categories_76 = Categories("StairsLandingTags")
categories_77 = Categories("StairsRailingTags")
categories_78 = Categories("StairsRunTags")
categories_79 = Categories("StairsSupportTags")
categories_80 = Categories("StairsTags")
categories_81 = Categories("StructConnectionTags")
categories_82 = Categories("StructuralColumnTags")
categories_83 = Categories("StructuralFoundationTags")
categories_84 = Categories("StructuralFramingTags")
categories_85 = Categories("StructuralStiffenerTags")
categories_86 = Categories("TelephoneDeviceTags")
categories_87 = Categories("TrussTags")
categories_88 = Categories("WallAnalyticalTags")
categories_89 = Categories("WallFoundationAnalyticalTags")
categories_90 = Categories("WallTags")
categories_91 = Categories("WindowTags")
categories_92 = Categories("WireTags")
categories_93 = Categories("ZoneTags")
# note: Some tag categories are currently not available.
# See https://github.com/DynamoDS/Dynamo/issues/4117 for more details.
create = List.Create(categories, categories_2, categories_3, categories_4, categories_5, categories_6, categories_7, categories_8, categories_9, categories_10, categories_11, categories_12, categories_13, categories_14, categories_15, categories_16, categories_17, categories_18, categories_19, categories_20, categories_21, categories_22, categories_23, categories_24, categories_25, categories_26, categories_27, categories_28, categories_29, categories_30, categories_31, categories_32, categories_33, categories_34, categories_35, categories_36, categories_37, categories_38, categories_39, categories_40, categories_41, categories_42, categories_43, categories_44, categories_45, categories_46, categories_47, categories_48, categories_49, categories_50, categories_51, categories_52, categories_53, categories_54, categories_55, categories_56, categories_57, categories_58, categories_59, categories_60, categories_61, categories_62, categories_63, categories_64, categories_65, categories_66, categories_67, categories_68, categories_69, categories_70, categories_71, categories_72, categories_73, categories_74, categories_75, categories_76, categories_77, categories_78, categories_79, categories_80, categories_81, categories_82, categories_83, categories_84, categories_85, categories_86, categories_87, categories_88, categories_89, categories_90, categories_91, categories_92, categories_93)
all_family_types_of_category = Custom[All Family Types Of Category](category=create)  # Gets all family types/symbols of a given category in the model (does *not *work for system families)
flatten = Flatten(all_family_types_of_category)
family = FamilyType.Family(flatten)
uniqueItems = List.UniqueItems(family)
watch = Watch(uniqueItems)
end = Revit.Transaction.Transaction.End(uniqueItems)
directory_path = Directory("C:\temp")
python_script = Python(IN[0]=end, IN[1]=directory_path)
# ---------- python_script.python (26 lines) ----------
import clr
clr.AddReference('RevitAPI')
from Autodesk.Revit.DB import *

clr.AddReference("RevitNodes")
import Revit
clr.ImportExtensions(Revit.Elements)

clr.AddReference("RevitServices")
import RevitServices
from RevitServices.Persistence import DocumentManager
from RevitServices.Transactions import TransactionManager

doc = DocumentManager.Instance.CurrentDBDocument
fams = UnwrapElement(IN[0])
path = IN[1]
counter = 0

TransactionManager.Instance.EnsureInTransaction(doc)
for fam in fams:
	fpath = path + "\\" + fam.Name + ".rfa"
	fdoc = doc.EditFamily(fam)
	fdoc.SaveAs(fPath)
	fdoc.Close(False)
TransactionManager.Instance.TransactionTaskDone()
OUT = elementlist
# ----------------------------------------
