# Dynamo graph CreatePresets.dyn (Dynamo 0.9.0.3067)

# group: INPUTS
# note: This graph will create all possible permutations of slider values in a given graph and create presets in that graph.
file_path = Filename("C:\temp\DynamoAutomation\slave_graphs\PresetTestFile.dyn")
code_block = CodeBlock()
# ---------- code_block.designscript (10 lines) ----------
// Slider names
{"Slider1","Slider2"};
// Old suffix
".dyn";
// New suffix
"_presets.dyn";
// Old directory
"slave_graphs";
// New directory
"output";
# ----------------------------------------

# group: Create preset file with permutations of all possible slider values
replace = String.Replace(str=file_path, searchFor=code_block.out1, replaceWith=code_block.out2)
replace_2 = String.Replace(str=replace, searchFor=code_block.out3, replaceWith=code_block.out4)
byWorkspacePathSliderNamesAndNewPath = Dynamo.Automation.Presets.ByWorkspacePathSliderNamesAndNewPath(file_path, code_block.out0, replace_2)
