# Dynamo graph Scenario_A1_withConfig.dyn (Dynamo 0.9.0.2912)

# group: Read configuration file
# note: Example for scenario A1: Process a directory of standalone Revit models, in this case based on a custom config file located at C:\temp\DynamoAutomation\misc\A1_Config.txt
# The slave graph will count the walls in each model and write the results into C:\temp\DynamoAutomation\output\AutomatedReport.CSV
# REQUIRED PACKAGES:
# - Clockwork for Dynamo 0.9.x
# - DynamoAutomation
# - LunchBox
file_path = Filename("C:\temp\DynamoAutomation\misc\A1_Config.txt")
fromPath = FileObject(file_path)  # "File.FromPath"
readText = File.ReadText(fromPath)
string = StringInput("\n")
split = String.Split(readText, string)
string_2 = StringInput("=")
split_2 = String.Split(split, string_2)
trimWhitespace = String.TrimWhitespace(split_2)
transpose = List.Transpose(trimWhitespace)
code_block = CodeBlock(seq=transpose) { seq[0]; seq[1]; }
createDictionary = Lists.Dictionary.CreateDictionary(code_block.out0, code_block.out1)
string_3 = StringInput("""RevitVersion
ModelDir
GraphPath
JournalFileName
OutputDir
JournalOverwrite""")
string_4 = StringInput("\n")
split_3 = String.Split(string_3, string_4)
getValueFromDictionary = Lists.Dictionary.GetValueFromDictionary(createDictionary, split_3)
flatten = Flatten(getValueFromDictionary)
code_block_2 = CodeBlock(seq=flatten) { seq[0]; seq[1]; seq[2]; seq[3]; seq[4]; seq[5]; }
string_5 = StringInput("1")
eq = code_block_2.out5 == string_5

# group: Create list of Revit files
fromPath_2 = DirectoryObject(code_block_2.out1)  # "Directory.FromPath"
code_block_3 = CodeBlock { "*.rvt"; }
contents = Directory.Contents(fromPath_2, code_block_3)

# group: Create journal files
byVersion = Custom[RevitAddinsPath.ByVersion](RevitVersion=code_block_2.out0)  # Returns the path of Revit Addins folder based on a given Revit version
string_6 = StringInput("\")
count = List.Count(contents)
code_block_4 = CodeBlock(n=count) { 1..n; }
string_from_object = FromObject(code_block_4)
code_block_5 = CodeBlock(jdir=byVersion, delimiter=string_6, jfilename=code_block_2.out3, n=string_from_object)
# ---------- code_block_5.designscript (2 lines) ----------
// Create file names for journal files
jdir + delimiter + jfilename + "_" + n + ".txt";
# ----------------------------------------
byWorkspacePath = Dynamo.Automation.Journal.ByWorkspacePath(contents, code_block_2.out2, code_block_5)

# group: Batch-process Revit files
byVersion_2 = Custom[RevitExecutablePath.ByVersion](RevitVersion=code_block_2.out0)  # Returns the path of Revit.exe based on a given Revit version
code_block_6 = CodeBlock(jpath=byWorkspacePath)
# ---------- code_block_6.designscript (6 lines) ----------
// You'll need an English language version of Revit
// in order to run the journals.
// If that is your default language
// you won't need this code block.
// This is what needs to appended to the exectuable path:
" /language ENU " + jpath;
# ----------------------------------------
byPathAndArguments = ProcessRunner.Process.ByPathAndArguments(byVersion_2, code_block_6)
cleanup = Custom[JournalFiles.Cleanup](destinationDirectory=code_block_2.out4, overwriteExistingFiles=eq, executionDone=byPathAndArguments, generatedJournalFiles=byWorkspacePath)  # Moves all journal files created during a batch-processing operation to a specified directory
