# Dynamo graph Scenario_B.dyn (Dynamo 0.9.0.2912)

# group: INPUTS
directory_path_journal_files = Directory("C:\temp\DynamoAutomation\output")
overwrite_existing_journal_files = BoolSelector(true)
# note: Example for scenario B: Let the first slave graph find all links within a given model and subsequently process that list of filenames with a second slave graph
# The second slave graph will count the walls in the linked models and write the results into C:\temp\DynamoAutomation\output\AutomatedReport.CSV
# REQUIRED PACKAGES:
# - Clockwork for Dynamo 0.9.x
# - DynamoAutomation
revit_version = StringInput("2016")
report_csv_file_name = StringInput("LinkedFiles")
file_path_revit_file = Filename("C:\temp\DynamoAutomation\revit_models\MasterModel.rvt")
file_path_dynamo_file_1 = Filename("C:\temp\DynamoAutomation\slave_graphs\ExtractLinkedModels_R2016.dyn")
journal_file_name = StringInput("DynamoJournalFile")
file_path_dynamo_file_2 = Filename("C:\temp\DynamoAutomation\slave_graphs\CountWalls_R2016.dyn")

# group: Create journal file
string = StringInput("\")
byVersion = Custom[RevitAddinsPath.ByVersion](RevitVersion=revit_version)  # Returns the path of Revit Addins folder based on a given Revit version
code_block = CodeBlock(jdir=byVersion, delimiter=string, jfilename=journal_file_name)
# ---------- code_block.designscript (2 lines) ----------
// Create file name for journal file
jdir + delimiter + jfilename + "_Master.txt";
# ----------------------------------------
byWorkspacePath = Dynamo.Automation.Journal.ByWorkspacePath(file_path_revit_file, file_path_dynamo_file_1, code_block)

# group: Process master model
byVersion_2 = Custom[RevitExecutablePath.ByVersion](RevitVersion=revit_version)  # Returns the path of Revit.exe based on a given Revit version
code_block_2 = CodeBlock(jpath=byWorkspacePath)
# ---------- code_block_2.designscript (7 lines) ----------
// You'll need an English language version of Revit
// in order to run the journals.
// If that is your default language
// you won't need this code block.
// This is what needs to appended to the exectuable path for Revit 2016.
// It may be different for Revit 2015.
" /language ENU " + jpath;
# ----------------------------------------
byPathAndArguments = ProcessRunner.Process.ByPathAndArguments(byVersion_2, code_block_2)

# group: Create list of linked models
code_block_3 = CodeBlock(dir=directory_path_journal_files, delimiter=string, reportcsvname=report_csv_file_name, done=byPathAndArguments)
# ---------- code_block_3.designscript (3 lines) ----------
linksPath = dir + delimiter + reportcsvname + ".CSV";
// Make sure that the links have already been extracted
{linksPath,done}[0];
# ----------------------------------------
fromPath = FileObject(code_block_3.out1)  # "File.FromPath"
readFromFile = CSV.ReadFromFile(fromPath)
flatten = Flatten(readFromFile)

# group: Create journal file
byVersion_3 = Custom[RevitAddinsPath.ByVersion](RevitVersion=revit_version)
count = List.Count(flatten)
code_block_4 = CodeBlock(n=count) { 1..n; }
string_from_object = FromObject(code_block_4)
code_block_5 = CodeBlock(jdir=byVersion_3, delimiter=string, filename=journal_file_name, n=string_from_object)
# ---------- code_block_5.designscript (2 lines) ----------
// Create file name for journal file
jdir + delimiter + filename + "_" + n + ".txt";
# ----------------------------------------
byWorkspacePath_2 = Dynamo.Automation.Journal.ByWorkspacePath(flatten, file_path_dynamo_file_2, code_block_5)

# group: Batch-process linked models
byVersion_4 = Custom[RevitExecutablePath.ByVersion](RevitVersion=revit_version)
code_block_6 = CodeBlock(jpath=byWorkspacePath_2)  # same code as code_block_2
byPathAndArguments_2 = ProcessRunner.Process.ByPathAndArguments(byVersion_4, code_block_6)
join = List.Join(byWorkspacePath, byWorkspacePath_2)
cleanup = Custom[JournalFiles.Cleanup](destinationDirectory=directory_path_journal_files, overwriteExistingFiles=overwrite_existing_journal_files, executionDone=byPathAndArguments_2, generatedJournalFiles=join)  # Moves all journal files created during a batch-processing operation to a specified directory
