# Dynamo graph Scenario_C.dyn (Dynamo 0.9.0.2912)

# group: INPUTS
directory_path_revit_families = Directory("C:\temp\DynamoAutomation\revit_models\scenario_C")
overwrite_existing_journal_files = BoolSelector(true)
# note: Example for scenario C: Let the first slave graph modify a number of family files. The second slave graph will subseqently load and place all of the families in a project file. All altered files are saved to C:\temp\DynamoAutomation\output\
# REQUIRED PACKAGES:
# - Clockwork for Dynamo 0.9.x
# - DynamoAutomation
revit_version = StringInput("2016")
file_path_dynamo_file_slave_1 = Filename("C:\temp\DynamoAutomation\slave_graphs\ScenarioC_Slave1_AlterFamily.dyn")
journal_file_name = StringInput("DynamoJournalFile")
file_path_revit_project = Filename("C:\temp\DynamoAutomation\revit_models\scenario_C\blank_project.rvt")
file_path_dynamo_file_slave_2 = Filename("C:\temp\DynamoAutomation\slave_graphs\ScenarioC_Slave2_LoadAndPlaceFamilies.dyn")

# group: Create list of Revit families
fromPath = DirectoryObject(directory_path_revit_families)  # "Directory.FromPath"
code_block = CodeBlock { "*.rfa"; }
contents = Directory.Contents(fromPath, code_block)

# group: Create journal files for families
byVersion = Custom[RevitAddinsPath.ByVersion](RevitVersion=revit_version)  # Returns the path of Revit Addins folder based on a given Revit version
string = StringInput("\")
count = List.Count(contents)
code_block_2 = CodeBlock(n=count) { 1..n; }
string_from_object = FromObject(code_block_2)
code_block_3 = CodeBlock(jdir=byVersion, delimiter=string, jfilename=journal_file_name, n=string_from_object)
# ---------- code_block_3.designscript (2 lines) ----------
// Create file names for journal files
jdir + delimiter + jfilename + "_Slave1_" + n + ".txt";
# ----------------------------------------
byWorkspacePath = Dynamo.Automation.Journal.ByWorkspacePath(contents, file_path_dynamo_file_slave_1, code_block_3)

# group: Batch-process Revit families
byVersion_2 = Custom[RevitExecutablePath.ByVersion](RevitVersion=revit_version)  # Returns the path of Revit.exe based on a given Revit version
code_block_4 = CodeBlock(jpath=byWorkspacePath)
# ---------- code_block_4.designscript (7 lines) ----------
// You'll need an English language version of Revit
// in order to run the journals.
// If that is your default language
// you won't need this code block.
// This is what needs to appended to the exectuable path for Revit 2016.
// It may be different for Revit 2015.
" /language ENU " + jpath;
# ----------------------------------------
byPathAndArguments = ProcessRunner.Process.ByPathAndArguments(byVersion_2, code_block_4)
cleanup = Custom[JournalFiles.Cleanup](destinationDirectory=directory_path_revit_families, overwriteExistingFiles=overwrite_existing_journal_files, executionDone=byPathAndArguments, generatedJournalFiles=byWorkspacePath)  # Moves all journal files created during a batch-processing operation to a specified directory

# group: Create journal file for project
byVersion_3 = Custom[RevitAddinsPath.ByVersion](RevitVersion=revit_version)
string_2 = StringInput("\")
code_block_5 = CodeBlock(jdir=byVersion_3, delimiter=string_2, jfilename=journal_file_name)
# ---------- code_block_5.designscript (2 lines) ----------
// Create file names for journal files
jdir + delimiter + jfilename + "_Slave2.txt";
# ----------------------------------------
byWorkspacePath_2 = Dynamo.Automation.Journal.ByWorkspacePath(file_path_revit_project, file_path_dynamo_file_slave_2, code_block_5)

# group: Process Revit project
byVersion_4 = Custom[RevitExecutablePath.ByVersion](RevitVersion=revit_version)
code_block_6 = CodeBlock(passthrough=cleanup, exepath=byVersion_4)
# ---------- code_block_6.designscript (2 lines) ----------
// Make sure all families have been processed
{passthrough,exepath}[1];
# ----------------------------------------
code_block_7 = CodeBlock(jpath=byWorkspacePath_2)  # same code as code_block_4
byPathAndArguments_2 = ProcessRunner.Process.ByPathAndArguments(code_block_6, code_block_7)
cleanup_2 = Custom[JournalFiles.Cleanup](destinationDirectory=directory_path_revit_families, overwriteExistingFiles=overwrite_existing_journal_files, executionDone=byPathAndArguments_2, generatedJournalFiles=byWorkspacePath_2)
