# Dynamo graph CountWalls_R2016_withConfig.dyn (Dynamo 0.9.0.2912)

string = StringInput("\")

# group: Read configuration file
# note: Example for a slave graph that retrieves information from a model and adds it to an existing CSV file, in this case based on a custom config file located at C:\temp\DynamoAutomation\misc\A1_Config.txt
# REQUIRED PACKAGES:
# - Lunchbox
file_path = Filename("C:\temp\DynamoAutomation\misc\A1_Config.txt")
fromPath = FileObject(file_path)  # "File.FromPath"
readText = File.ReadText(fromPath)
string_2 = StringInput("\n")
split = String.Split(readText, string_2)
string_3 = StringInput("=")
string_4 = StringInput("""OutputDir
ReportFileName
GraphPath""")
string_5 = StringInput("\n")
split_2 = String.Split(string_4, string_5)

split_3 = String.Split(split, string_3)

# group (continued): Read configuration file
trimWhitespace = String.TrimWhitespace(split_3)
transpose = List.Transpose(trimWhitespace)
code_block = CodeBlock(seq=transpose) { seq[0]; seq[1]; }
createDictionary = Lists.Dictionary.CreateDictionary(code_block.out0, code_block.out1)
getValueFromDictionary = Lists.Dictionary.GetValueFromDictionary(createDictionary, split_2)
flatten = Flatten(getValueFromDictionary)
code_block_2 = CodeBlock(seq=flatten) { seq[0]; seq[1]; seq[2]; }
split_4 = String.Split(code_block_2.out2, string)
lastItem = List.LastItem(split_4)

# group: Collect data from CSV file
string_6 = StringInput("\")
code_block_3 = CodeBlock(dir=code_block_2.out0, delimiter=string_6, filename=code_block_2.out1) { dir + delimiter + filename + ".CSV"; }
fromPath_2 = FileObject(code_block_3)  # "File.FromPath"
readFromFile = CSV.ReadFromFile(fromPath_2)

# group: Collect data from model
current = Document.Current()
filePath = Document.FilePath(current)
categories = Categories("Walls")
all_elements_of_category = ElementsOfCategory(categories)
count = List.Count(all_elements_of_category)
now = DateTime.Now()
code_block_4 = CodeBlock(path=filePath, count=count, scriptname=lastItem, now=now) { {{path,count,scriptname,now}}; }

# group: Append collected data to CSV file
join = List.Join(readFromFile, code_block_4)
writeToFile = CSV.WriteToFile(code_block_3, join)
