# Dynamo graph PresetTestFile.dyn (Dynamo 0.9.0.3067)

slider1 = IntegerSlider(0, range=0..5 step 1)
slider1_2 = IntegerSlider(2, range=2..5 step 1)
code_block = CodeBlock(a=slider1, b=slider1_2) { a+b; }
