# Dynamo graph ScenarioC_Slave1_AlterFamily.dyn (Dynamo 0.9.0.2912)

# group: Alter model text
element_types = ElementTypes("ModelText")
all_elements_of_type = ElementsOfType(element_types)
text = Custom[TextElement.Text](element=all_elements_of_type)  # Gets the text stored in a text element (i.e. text note or model text)
code_block = CodeBlock(txt=text) { txt + "\nand Dynamo just \naltered it..."; }
setText = Custom[TextElement.SetText](element=all_elements_of_type, text=code_block)  # Sets the text of a given text element (i.e. text note or model text)

# group: INPUTS
# note: Example for a slave graph that alters a family and saves it under a new name.
directory_path = Directory("C:\temp\DynamoAutomation\output")

# group: Create new file path
string = StringInput("\")
current = Document.Current()
filePath = Document.FilePath(current)
boolean = BoolSelector(true)
fileName = FilePath.FileName(filePath, boolean)
code_block_2 = CodeBlock { ".rfa"; "_altered.rfa"; }
replace = String.Replace(str=fileName, searchFor=code_block_2.out0, replaceWith=code_block_2.out1)
code_block_3 = CodeBlock(dir=directory_path, delimiter=string, filename=replace) { dir + delimiter + filename; }

# group: Save altered family
code_block_4 = CodeBlock(a=setText.success, b=code_block_3)
# ---------- code_block_4.designscript (3 lines) ----------
// Make sure we only pass the file path
// after the modeltext has been altered
{a,b}[1];
# ----------------------------------------
end = Revit.Transaction.Transaction.End(code_block_4)
saveAs = Custom[Document.SaveAs](filePath=end)  # Saves the active Revit document under the given name.
