# Dynamo graph AnalyzeJournalFiles.dyn (Dynamo 1.0.0.1180)

file_path = Filename("c:\netz\adieckmann\Desktop\journal.0797.txt")
fromPath = FileObject(file_path)  # "File.FromPath"
extractAPIErrors = Custom[JournalFile.ExtractAPIErrors](file=fromPath)  # Extracts all API errors from a Revit journal file
watch = Watch(extractAPIErrors.error)
watch_2 = Watch(extractAPIErrors.line)
extractCommands = Custom[JournalFile.ExtractCommands](file=fromPath)  # Extracts all commands from a journal file
watch_3 = Watch(extractCommands.Description)
watch_4 = Watch(extractCommands.ID)
watch_5 = Watch(extractCommands.Type)
stripComments = Custom[JournalFile.StripComments](file=fromPath)  # Strips all comments from a Revit journal file.
watch_6 = Watch(stripComments)
