# Dynamo graph BatchPurge_Faster.dyn (Dynamo 1.3.0.875)

# group: INPUTS
# note: Example for purging Revit projects/families.
# Will open all Revit models in a single Revit session.
# REQUIRED PACKAGES:
# - Clockwork for Dynamo 1.x
# - DynamoAutomation
revit_version = StringInput("2016")
directory_path_revit_models = Directory("C:\temp\DynamoAutomation\revit_models\dir1")
directory_path_journal_files = Directory("C:\temp\DynamoAutomation\output")
journal_file_name = StringInput("DynamoJournalFile")

# group: Create list of Revit files
fromPath = DirectoryObject(directory_path_revit_models)  # "Directory.FromPath"
code_block = CodeBlock { "*.rvt"; }
contents = Directory.Contents(fromPath, code_block)

# group: Copy models to output directory
directoryName = FilePath.DirectoryName(contents)
replace = String.Replace(str=contents, searchFor=directoryName, replaceWith=directory_path_journal_files)
fromPath_2 = FileObject(contents)  # "File.FromPath"
boolean = BoolSelector(true)
copy = File.Copy(fromPath_2, replace, boolean)
passthrough = Custom[Passthrough](passThrough=replace, waitFor=copy)  # Forces a sequential order of execution. The node wired into the output of the Passthrough node will be executed *after* the node wired into the waitFor input (e.g. important for some Revit operations). The value of the passThrough input will be passed on to the node wired into the output port of the Passthrough node.

# group: Create journal file
string = StringInput("\")
code_block_2 = CodeBlock(jdir=directory_path_journal_files, delimiter=string, jfilename=journal_file_name)
# ---------- code_block_2.designscript (2 lines) ----------
// Create file names for journal files
jdir + delimiter + jfilename + ".txt";
# ----------------------------------------
purgeModels = Dynamo.Automation.Journal.PurgeModels(passthrough, code_block_2)

# group: Batch-purge Revit models
byVersion = Custom[RevitExecutablePath.ByVersion](revitVersion=revit_version)  # Returns the path of Revit.exe based on a given Revit version
revitStartupArguments = Custom[Journal.RevitStartupArguments](journalPath=purgeModels)  # Creates startup arguments for Revit
byPathAndArguments = ProcessRunner.Process.ByPathAndArguments(byVersion, revitStartupArguments)
