# Dynamo graph BatchPurge_Safer.dyn (Dynamo 1.3.0.875)

# group: INPUTS
# note: Example for purging Revit projects/families.
# Will open a separate Revit session for each Revit model.
# REQUIRED PACKAGES:
# - Clockwork for Dynamo 1.x
# - DynamoAutomation
revit_version = StringInput("2016")
directory_path_revit_models = Directory("C:\temp\DynamoAutomation\revit_models\dir1")
directory_path_journal_files = Directory("C:\temp\DynamoAutomation\output")
journal_file_name = StringInput("DynamoJournalFile")

# group: Create list of Revit files
fromPath = DirectoryObject(directory_path_revit_models)  # "Directory.FromPath"
code_block = CodeBlock { "*.rvt"; }
contents = Directory.Contents(fromPath, code_block)

# group: Create journal files
string = StringInput("\")
count = List.Count(contents)
code_block_2 = CodeBlock(n=count) { 1..n; }
string_from_object = FromObject(code_block_2)
code_block_3 = CodeBlock(jdir=directory_path_journal_files, delimiter=string, jfilename=journal_file_name, n=string_from_object)
# ---------- code_block_3.designscript (2 lines) ----------
// Create file names for journal files
jdir + delimiter + jfilename + "_" + n + ".txt";
# ----------------------------------------
toNumber = String.ToNumber(revit_version)
purgeModel = Dynamo.Automation.Journal.PurgeModel(contents, code_block_3, toNumber)

# group: Batch-purge Revit models
byVersion = Custom[RevitExecutablePath.ByVersion](revitVersion=revit_version)  # Returns the path of Revit.exe based on a given Revit version
revitStartupArguments = Custom[Journal.RevitStartupArguments](journalPath=purgeModel)  # Creates startup arguments for Revit
byPathAndArguments = ProcessRunner.Process.ByPathAndArguments(byVersion, revitStartupArguments)
