# Dynamo graph Scenario_A1_SchedulableWithConfig.dyn (Dynamo 1.3.1.1736)

# group: INPUTS
# note: Example for scenario A1: Process a directory of standalone Revit models, in this case based on a custom config file located at C:\temp\DynamoAutomation\misc\A1_Config.txt
# The slave graph will count the walls in each model and write the results into C:\temp\DynamoAutomation\output\AutomatedReport.CSV
# REQUIRED PACKAGES:
# - Clockwork for Dynamo 1.x
# - DynamoAutomation
file_path = Filename("..\misc\A1_Config_R2017Schedulable.txt")
string = StringInput("""RevitVersion
ModelDir
GraphPath
JournalFileName
OutputDir
JournalOverwrite""")

# group: Read configuration file
string_2 = StringInput("\n")
split = String.Split(string, string_2)
read = Custom[Config.Read](filepath=file_path, configKeys=split)  # Reads a configuration file at a given filepath. Items in the config file need to be separated by line breaks. Expected format for each item is key=value
code_block = CodeBlock(seq=read)
# ---------- code_block.designscript (12 lines) ----------
// Revit version
seq[0];
// Model directory
seq[1];
// Slave graph path
seq[2];
// Journal file name
seq[3];
// Output directory
seq[4];
// Overwrite journals?
seq[5];
# ----------------------------------------
string_3 = StringInput("1")
eq = code_block.out5 == string_3

# group: Create list of Revit files
fromPath = DirectoryObject(code_block.out1)  # "Directory.FromPath"
code_block_2 = CodeBlock { "*.rvt"; }
contents = Directory.Contents(fromPath, code_block_2)

# group: Create journal files
byVersion = Custom[RevitAddinsPath.ByVersion](revitVersion=code_block.out0)  # Returns the path of Revit Addins folder based on a given Revit version
string_4 = StringInput("\")
count = List.Count(contents)
code_block_3 = CodeBlock(n=count) { 1..n; }
string_from_object = FromObject(code_block_3)
code_block_4 = CodeBlock(jdir=byVersion, delimiter=string_4, jfilename=code_block.out3, n=string_from_object)
# ---------- code_block_4.designscript (2 lines) ----------
// Create file names for journal files
jdir + delimiter + jfilename + "_" + n + ".txt";
# ----------------------------------------
byWorkspacePath = Dynamo.Automation.Journal.ByWorkspacePath(contents, code_block.out2, code_block_4, code_block.out0)

# group: Create batch file
string_5 = StringInput("example.bat")
combine = FilePath.Combine(code_block.out4, string_5)
string_6 = StringInput("\n")
string_7 = StringInput("""@echo off 
:: Make sure to start all calls with the /W option in order to execute them successively
echo This is an example for starting multiple Revit sessions
:: Change to Revit's working directory""")
byVersion_2 = Custom[RevitExecutablePath.ByVersion](revitVersion=code_block.out0)  # Returns the path of Revit.exe based on a given Revit version
directoryName = FilePath.DirectoryName(byVersion_2)
code_block_5 = CodeBlock(path=directoryName) { "cd " + path; }
create = List.Create(string_7, code_block_5)
string_8 = StringInput("start /W ")
fileName = FilePath.FileName(byVersion_2)
revitStartupArguments = Custom[Journal.RevitStartupArguments](journalPath=byWorkspacePath)  # Creates startup arguments for Revit
code_block_6 = CodeBlock(start=string_8, process=fileName, args=revitStartupArguments) { start + process + args; }
string_9 = StringInput("""@echo off 
echo All done...
:: Use the pause command to keep the window from closing automatically
pause""")
join = List.Join(create, code_block_6, string_9)
join_2 = String.Join(string_6, join)
firstItem = List.FirstItem(join_2)
writeText = File.WriteText(combine, firstItem)
