# Dynamo graph Scenario_A1_withConfig.dyn (Dynamo 1.0.0.1180)

# group: INPUTS
# note: Example for scenario A1: Process a directory of standalone Revit models, in this case based on a custom config file located at C:\temp\DynamoAutomation\misc\A1_Config.txt
# The slave graph will count the walls in each model and write the results into C:\temp\DynamoAutomation\output\AutomatedReport.CSV
# REQUIRED PACKAGES:
# - Clockwork for Dynamo 1.x
# - DynamoAutomation
file_path = Filename("..\misc\A1_Config_R2016.txt")
string = StringInput("""RevitVersion
ModelDir
GraphPath
JournalFileName
OutputDir
JournalOverwrite""")

# group: Read configuration file
string_2 = StringInput("\n")
split = String.Split(string, string_2)
read = Custom[Config.Read](filepath=file_path, configKeys=split)  # Reads a configuration file at a given filepath. Items in the config file need to be separated by line breaks. Expected format for each item is key=value
code_block = CodeBlock(seq=read)
# ---------- code_block.designscript (12 lines) ----------
// Revit version
seq[0];
// Model directory
seq[1];
// Slave graph path
seq[2];
// Journal file name
seq[3];
// Output directory
seq[4];
// Overwrite journals?
seq[5];
# ----------------------------------------
string_3 = StringInput("1")
eq = code_block.out5 == string_3

# group: Create list of Revit files
fromPath = DirectoryObject(code_block.out1)  # "Directory.FromPath"
code_block_2 = CodeBlock { "*.rvt"; }
contents = Directory.Contents(fromPath, code_block_2)

# group: Create journal files
byVersion = Custom[RevitAddinsPath.ByVersion](revitVersion=code_block.out0)  # Returns the path of Revit Addins folder based on a given Revit version
string_4 = StringInput("\")
count = List.Count(contents)
code_block_3 = CodeBlock(n=count) { 1..n; }
string_from_object = FromObject(code_block_3)
code_block_4 = CodeBlock(jdir=byVersion, delimiter=string_4, jfilename=code_block.out3, n=string_from_object)
# ---------- code_block_4.designscript (2 lines) ----------
// Create file names for journal files
jdir + delimiter + jfilename + "_" + n + ".txt";
# ----------------------------------------
byWorkspacePath = Dynamo.Automation.Journal.ByWorkspacePath(contents, code_block.out2, code_block_4, code_block.out0)

# group: Batch-process Revit files
byVersion_2 = Custom[RevitExecutablePath.ByVersion](revitVersion=code_block.out0)  # Returns the path of Revit.exe based on a given Revit version
revitStartupArguments = Custom[Journal.RevitStartupArguments](journalPath=byWorkspacePath)  # Creates startup arguments for Revit
byPathAndArguments = ProcessRunner.Process.ByPathAndArguments(byVersion_2, revitStartupArguments)
cleanup = Custom[JournalFiles.Cleanup](destinationDirectory=code_block.out4, overwriteExistingFiles=eq, executionDone=byPathAndArguments, generatedJournalFiles=byWorkspacePath)  # Moves all journal files created during a batch-processing operation to a specified directory
