# Dynamo graph Scenario_A2_R2016.dyn (Dynamo 1.0.0.1180)

# group: INPUTS
directory_path_journal_files = Directory("C:\temp\DynamoAutomation\output")
overwrite_existing_journal_files = BoolSelector(true)
# note: Example for scenario A2: Process a list of directories of standalone Revit models, in this case based on the contents of C:\temp\DynamoAutomation\misc\A2_Directory_Paths.txt
# The slave graph will count the windows in each model and write the results into indvidual reports located in C:\temp\DynamoAutomation\output
# REQUIRED PACKAGES:
# - DynamoAutomation
revit_version = StringInput("2016")
file_path_csv_file_of_directory = Filename("C:\temp\DynamoAutomation\misc\A2_Directory_Paths.txt")  # "File Path (CSV File of Directory Paths)"
file_path_dynamo_file = Filename("C:\temp\DynamoAutomation\slave_graphs\CountWindows_R2016.dyn")
journal_file_name = StringInput("DynamoJournalFile")

# group: Create list of Revit files
fromPath = FileObject(file_path_csv_file_of_directory)  # "File.FromPath"
readFromFile = CSV.ReadFromFile(fromPath)
flatten = Flatten(readFromFile)
code_block = CodeBlock { "*.rvt"; }

exists = Directory.Exists(flatten)
filterByBoolMask = List.FilterByBoolMask(list=flatten, mask=exists)

# group (continued): Create list of Revit files
fromPath_2 = DirectoryObject(filterByBoolMask.in)  # "Directory.FromPath"
contents = Directory.Contents(fromPath_2, code_block)
flatten_2 = Flatten(contents)

# group: Create journal files
byVersion = Custom[RevitAddinsPath.ByVersion](revitVersion=revit_version)  # Returns the path of Revit Addins folder based on a given Revit version
string = StringInput("\")
count = List.Count(flatten_2)
code_block_2 = CodeBlock(n=count) { 1..n; }
string_from_object = FromObject(code_block_2)
code_block_3 = CodeBlock(jdir=byVersion, delimiter=string, jfilename=journal_file_name, n=string_from_object)
# ---------- code_block_3.designscript (2 lines) ----------
// Create file names for journal files
jdir + delimiter + jfilename + "_" + n + ".txt";
# ----------------------------------------
byWorkspacePath = Dynamo.Automation.Journal.ByWorkspacePath(flatten_2, file_path_dynamo_file, code_block_3, revit_version)

# group: Batch-process Revit files
byVersion_2 = Custom[RevitExecutablePath.ByVersion](revitVersion=revit_version)  # Returns the path of Revit.exe based on a given Revit version
revitStartupArguments = Custom[Journal.RevitStartupArguments](journalPath=byWorkspacePath)  # Creates startup arguments for Revit
byPathAndArguments = ProcessRunner.Process.ByPathAndArguments(byVersion_2, revitStartupArguments)
cleanup = Custom[JournalFiles.Cleanup](destinationDirectory=directory_path_journal_files, overwriteExistingFiles=overwrite_existing_journal_files, executionDone=byPathAndArguments, generatedJournalFiles=byWorkspacePath)  # Moves all journal files created during a batch-processing operation to a specified directory
