# Dynamo graph Scenario_A4_R2016.dyn (Dynamo 1.3.0.875)

# group: INPUTS
directory_path_journal_files = Directory("C:\temp\DynamoAutomation\output")
overwrite_existing_journal_files = BoolSelector(true)
# note: Example for scenario A4:
# Recursively process a directory and all subdirectories for standalone Revit models
# The slave graph will count the walls in each model and write the results into C:\temp\DynamoAutomation\output\AutomatedReport.CSV
# REQUIRED PACKAGES:
# - Clockwork for Dynamo 1.x
# - DynamoAutomation
revit_version = StringInput("2016")
directory_path_revit_models = Directory("C:\temp\DynamoAutomation\revit_models")
file_path_dynamo_file = Filename("C:\temp\DynamoAutomation\slave_graphs\CountWalls_R2016.dyn")
journal_file_name = StringInput("DynamoJournalFile")

# group: Create list of Revit files
code_block = CodeBlock { "*.rvt"; }
contents = Custom[Directory.ContentsAll](directoryPath=directory_path_revit_models, searchString=code_block)  # "Directory.Contents+"; Unlike the built-in node Directory.Contents, this node browses a directory recursively and returns all relevant files contained in subfolders as well.

# group: Create journal files
byVersion = Custom[RevitAddinsPath.ByVersion](revitVersion=revit_version)  # Returns the path of Revit Addins folder based on a given Revit version
string = StringInput("\")
count = List.Count(contents)
code_block_2 = CodeBlock(n=count) { 1..n; }
string_from_object = FromObject(code_block_2)
code_block_3 = CodeBlock(jdir=byVersion, delimiter=string, jfilename=journal_file_name, n=string_from_object)
# ---------- code_block_3.designscript (2 lines) ----------
// Create file names for journal files
jdir + delimiter + jfilename + "_" + n + ".txt";
# ----------------------------------------
boolean = BoolSelector(true)
byWorkspacePath = Dynamo.Automation.Journal.ByWorkspacePath(contents, file_path_dynamo_file, code_block_3, revit_version, boolean)

# group: Batch-process Revit files
byVersion_2 = Custom[RevitExecutablePath.ByVersion](revitVersion=revit_version)  # Returns the path of Revit.exe based on a given Revit version
revitStartupArguments = Custom[Journal.RevitStartupArguments](journalPath=byWorkspacePath)  # Creates startup arguments for Revit
byPathAndArguments = ProcessRunner.Process.ByPathAndArguments(byVersion_2, revitStartupArguments)
cleanup = Custom[JournalFiles.Cleanup](destinationDirectory=directory_path_journal_files, overwriteExistingFiles=overwrite_existing_journal_files, executionDone=byPathAndArguments, generatedJournalFiles=byWorkspacePath)  # Moves all journal files created during a batch-processing operation to a specified directory
