# Dynamo graph Scenario_C_R2016.dyn (Dynamo 1.0.0.1180)

# group: INPUTS
directory_path_revit_families = Directory("C:\temp\DynamoAutomation\revit_models\scenario_C")
overwrite_existing_journal_files = BoolSelector(true)
# note: Example for scenario C: Let the first slave graph modify a number of family files. The second slave graph will subseqently load and place all of the families in a project file. All altered files are saved to C:\temp\DynamoAutomation\output\
# REQUIRED PACKAGES:
# - Clockwork for Dynamo 1.x
# - DynamoAutomation
revit_version = StringInput("2016")
file_path_dynamo_file_slave_1 = Filename("..\slave_graphs\ScenarioC_Slave1_AlterFamily_R2016.dyn")
journal_file_name = StringInput("DynamoJournalFile")
file_path_revit_project = Filename("C:\temp\DynamoAutomation\revit_models\scenario_C\blank_project.rvt")
file_path_dynamo_file_slave_2 = Filename("..\slave_graphs\ScenarioC_Slave2_LoadAndPlaceFamilies_R2016.dyn")

# group: Create list of Revit families
fromPath = DirectoryObject(directory_path_revit_families)  # "Directory.FromPath"
code_block = CodeBlock { "*.rfa"; }
contents = Directory.Contents(fromPath, code_block)

# group: Create journal files for families
byVersion = Custom[RevitAddinsPath.ByVersion](revitVersion=revit_version)  # Returns the path of Revit Addins folder based on a given Revit version
string = StringInput("\")
count = List.Count(contents)
code_block_2 = CodeBlock(n=count) { 1..n; }
string_from_object = FromObject(code_block_2)
code_block_3 = CodeBlock(jdir=byVersion, delimiter=string, jfilename=journal_file_name, n=string_from_object)
# ---------- code_block_3.designscript (2 lines) ----------
// Create file names for journal files
jdir + delimiter + jfilename + "_Slave1_" + n + ".txt";
# ----------------------------------------
byWorkspacePath = Dynamo.Automation.Journal.ByWorkspacePath(contents, file_path_dynamo_file_slave_1, code_block_3, revit_version)

# group: Batch-process Revit families
byVersion_2 = Custom[RevitExecutablePath.ByVersion](revitVersion=revit_version)  # Returns the path of Revit.exe based on a given Revit version
revitStartupArguments = Custom[Journal.RevitStartupArguments](journalPath=byWorkspacePath)  # Creates startup arguments for Revit
byPathAndArguments = ProcessRunner.Process.ByPathAndArguments(byVersion_2, revitStartupArguments)
cleanup = Custom[JournalFiles.Cleanup](destinationDirectory=directory_path_revit_families, overwriteExistingFiles=overwrite_existing_journal_files, executionDone=byPathAndArguments, generatedJournalFiles=byWorkspacePath)  # Moves all journal files created during a batch-processing operation to a specified directory

# group: Create journal file for project
byVersion_3 = Custom[RevitAddinsPath.ByVersion](revitVersion=revit_version)
string_2 = StringInput("\")
code_block_4 = CodeBlock(jdir=byVersion_3, delimiter=string_2, jfilename=journal_file_name)
# ---------- code_block_4.designscript (2 lines) ----------
// Create file names for journal files
jdir + delimiter + jfilename + "_Slave2.txt";
# ----------------------------------------
byWorkspacePath_2 = Dynamo.Automation.Journal.ByWorkspacePath(file_path_revit_project, file_path_dynamo_file_slave_2, code_block_4, revit_version)

# group: Process Revit project
byVersion_4 = Custom[RevitExecutablePath.ByVersion](revitVersion=revit_version)
passthrough = Custom[Passthrough](passThrough=byVersion_4, waitFor=cleanup)  # Forces a sequential order of execution. The node wired into the output of the Passthrough node will be executed *after* the node wired into the waitFor input (e.g. important for some Revit operations). The value of the passThrough input will be passed on to the node wired into the output port of the Passthrough node.
revitStartupArguments_2 = Custom[Journal.RevitStartupArguments](journalPath=byWorkspacePath_2)
byPathAndArguments_2 = ProcessRunner.Process.ByPathAndArguments(passthrough, revitStartupArguments_2)
cleanup_2 = Custom[JournalFiles.Cleanup](destinationDirectory=directory_path_revit_families, overwriteExistingFiles=overwrite_existing_journal_files, executionDone=byPathAndArguments_2, generatedJournalFiles=byWorkspacePath_2)
