# Dynamo graph CountWalls_R2017.dyn (Dynamo 1.0.0.1180)

# group: INPUTS
terminate_revit_when_done = BoolSelector(true)
# note: Example for a slave graph that retrieves information from a model and adds it to an existing CSV file.
# REQUIRED PACKAGES:
# - Clockwork for Dynamo 1.x
# - DynamoAutomation
directory_path_csv_file = Directory("C:\temp\DynamoAutomation\output")
filename_csv_file = StringInput("AutomatedReport")
categories = Categories("Walls")
script_name = StringInput("CountWalls_R2017.dyn")

# group: Collect data from CSV file
string = StringInput("\")
code_block = CodeBlock(dir=directory_path_csv_file, delimiter=string, filename=filename_csv_file) { dir + delimiter + filename + ".CSV"; }
fromPath = FileObject(code_block)  # "File.FromPath"
readFromFile = CSV.ReadFromFile(fromPath)

# group: Collect data from model
current = Document.Current()
filePath = Document.FilePath(current)
all_elements_of_category = ElementsOfCategory(categories)
count = List.Count(all_elements_of_category)
now = DateTime.Now()
code_block_2 = CodeBlock(path=filePath, count=count, scriptname=script_name, now=now) { {{path,count,scriptname,now}}; }

# group: Append collected data to CSV file
join = List.Join(readFromFile, code_block_2)
writeToFile = CSV.WriteToFile(code_block, join)

# group: Terminate Revit
passthrough = Custom[Passthrough](passThrough=terminate_revit_when_done, waitFor=writeToFile)  # Forces a sequential order of execution. The node wired into the output of the Passthrough node will be executed *after* the node wired into the waitFor input (e.g. important for some Revit operations). The value of the passThrough input will be passed on to the node wired into the output port of the Passthrough node.
killCurrentProcess = ProcessRunner.Process.KillCurrentProcess(passthrough)
