# Dynamo graph CountWalls_R2017_withConfig.dyn (Dynamo 1.0.0.1180)

# group: INPUTS
terminate_revit_when_done = BoolSelector(false)
# note: Example for a slave graph that retrieves information from a model and adds it to an existing CSV file, in this case based on a custom config file located at C:\temp\DynamoAutomation\misc\A1_Config.txt
# REQUIRED PACKAGES:
# - Clockwork for Dynamo 1.x
# - DynamoAutomation
config_file_path = Filename("C:\temp\DynamoAutomation\misc\A1_Config.txt")
config_keys = StringInput("""OutputDir
ReportFileName
GraphPath""")

# group: Read configuration file
string = StringInput("\n")
split = String.Split(config_keys, string)
read = Custom[Config.Read](filepath=config_file_path, configKeys=split)  # Reads a configuration file at a given filepath. Items in the config file need to be separated by line breaks. Expected format for each item is key=value
code_block = CodeBlock(seq=read)
# ---------- code_block.designscript (6 lines) ----------
// Output directory
seq[0];
// Report file name
seq[1];
// Graph path
seq[2];
# ----------------------------------------
string_2 = StringInput("\")
split_2 = String.Split(code_block.out2, string_2)
lastItem = List.LastItem(split_2)

# group: Collect data from CSV file
string_3 = StringInput("\")
code_block_2 = CodeBlock(dir=code_block.out0, delimiter=string_3, filename=code_block.out1) { dir + delimiter + filename + ".CSV"; }
fromPath = FileObject(code_block_2)  # "File.FromPath"
readFromFile = CSV.ReadFromFile(fromPath)

# group: Collect data from model
current = Document.Current()
filePath = Document.FilePath(current)
categories = Categories("Walls")
all_elements_of_category = ElementsOfCategory(categories)
count = List.Count(all_elements_of_category)
now = DateTime.Now()
code_block_3 = CodeBlock(path=filePath, count=count, scriptname=lastItem, now=now) { {{path,count,scriptname,now}}; }

# group: Append collected data to CSV file
join = List.Join(readFromFile, code_block_3)
writeToFile = CSV.WriteToFile(code_block_2, join)

# group: Terminate Revit
passthrough = Custom[Passthrough](passThrough=terminate_revit_when_done, waitFor=writeToFile)  # Forces a sequential order of execution. The node wired into the output of the Passthrough node will be executed *after* the node wired into the waitFor input (e.g. important for some Revit operations). The value of the passThrough input will be passed on to the node wired into the output port of the Passthrough node.
killCurrentProcess = ProcessRunner.Process.KillCurrentProcess(passthrough)
