# Dynamo graph CountWindows_R2017.dyn (Dynamo 1.0.0.1180)

# group: INPUTS
terminate_revit_when_done = BoolSelector(false)
directory_path_reports = Directory("C:\temp\DynamoAutomation\output")
filename_report_files = StringInput("AutomatedReport")
# note: Example for a slave graph that retrieves information from a model and writes it to individual report files.
# REQUIRED PACKAGES:
# - Clockwork for Dynamo 1.x
# - DynamoAutomation
script_name = StringInput("CountWindows_R2016.dyn")
categories = Categories("Windows")

# group: Collect data from model
now = DateTime.Now()
current = Document.Current()
filePath = Document.FilePath(current)
all_elements_of_category = ElementsOfCategory(categories)
count = List.Count(all_elements_of_category)

# group: Create report content
string = StringInput("\n")
code_block = CodeBlock(path=filePath, scriptname=script_name, now=now, count=count) { "Checked Model: " + path; "Script Name: " + scriptname; "Timestamp: " + now; "Windows Counted: " + count; }
join = String.Join(string, code_block.out0, code_block.out1, code_block.out2, code_block.out3)

# group: Write report to file
string_2 = StringInput("\")
components = DateTime.Components(now)
create = List.Create(components.out1, components.out2, components.out3, components.out4, components.out5)
code_block_2 = CodeBlock { 2; }
withLeadingZeroes = Custom[List.WithLeadingZeroes](num=create, n=code_block_2)  # Adds leading zeros to a sequence of numbers
code_block_3 = CodeBlock(seq=withLeadingZeroes) { seq[0]; seq[1]; seq[2]; seq[3]; seq[4]; }
code_block_4 = CodeBlock(dir=directory_path_reports, delimiter=string_2, filename=filename_report_files, year=components.out0, month=code_block_3.out0, day=code_block_3.out1, hour=code_block_3.out2, min=code_block_3.out3, sec=code_block_3.out4) { dir + delimiter + filename + "_" + year + month + day + "-" + hour + min + sec + ".txt"; }
writeText = File.WriteText(code_block_4, join)

# group: Terminate Revit
passthrough = Custom[Passthrough](passThrough=terminate_revit_when_done, waitFor=writeText)  # Forces a sequential order of execution. The node wired into the output of the Passthrough node will be executed *after* the node wired into the waitFor input (e.g. important for some Revit operations). The value of the passThrough input will be passed on to the node wired into the output port of the Passthrough node.
killCurrentProcess = ProcessRunner.Process.KillCurrentProcess(passthrough)
