# Dynamo graph ExtractLinkedModels_R2017.dyn (Dynamo 1.0.0.1180)

# group: INPUTS
terminate_revit_when_done = BoolSelector(false)
# note: Example for a slave graph that extracts the paths of all linked models from a project and writes them to a CSV file.
# REQUIRED PACKAGES:
# - archi-lab.net
# - Clockwork for Dynamo 1.x
# - DynamoAutomation
directory_path = Directory("C:\temp\DynamoAutomation\output")
report_csv_file_name = StringInput("LinkedFiles")

# group: Collect data from model
get_documents = Custom[Get Documents]()  # Queries all linked Revit files and retrieves their Name, LinkInstance and Document properties.

# group: Write data to CSV file
string = StringInput("\")
code_block = CodeBlock(dir=directory_path, delimiter=string, csvname=report_csv_file_name) { dir + delimiter + csvname + ".CSV"; }
writeToFile = CSV.WriteToFile(code_block, get_documents.Link_Path)

# group: Terminate Revit
passthrough = Custom[Passthrough](passThrough=terminate_revit_when_done, waitFor=writeToFile)  # Forces a sequential order of execution. The node wired into the output of the Passthrough node will be executed *after* the node wired into the waitFor input (e.g. important for some Revit operations). The value of the passThrough input will be passed on to the node wired into the output port of the Passthrough node.
killCurrentProcess = ProcessRunner.Process.KillCurrentProcess(passthrough)
