# Dynamo graph ScenarioC_Slave1_AlterFamily_R2017.dyn (Dynamo 1.0.0.1180)

# group: INPUTS
terminate_revit_when_done = BoolSelector(false)
# note: Example for a slave graph that alters a family and saves it under a new name.
# REQUIRED PACKAGES:
# - Clockwork for Dynamo 1.x
# - DynamoAutomation
directory_path = Directory("C:\temp\DynamoAutomation\output")

# group: Create new file path
string = StringInput("\")
current = Document.Current()
filePath = Document.FilePath(current)
boolean = BoolSelector(true)
fileName = FilePath.FileName(filePath, boolean)
code_block = CodeBlock { ".rfa"; "_altered.rfa"; }
replace = String.Replace(str=fileName, searchFor=code_block.out0, replaceWith=code_block.out1)
code_block_2 = CodeBlock(dir=directory_path, delimiter=string, filename=replace) { dir + delimiter + filename; }

# group: Alter model text
element_types = ElementTypes("ModelText")
all_elements_of_type = ElementsOfType(element_types)
text = Custom[TextElement.Text](element=all_elements_of_type)  # Gets the text stored in a text element (i.e. text note or model text)
code_block_3 = CodeBlock(txt=text) { txt + "\nand Dynamo just \naltered it..."; }
setText = Custom[TextElement.SetText](element=all_elements_of_type, text=code_block_3)  # Sets the text of a given text element (i.e. text note or model text)

# group: Save altered family
passthrough = Custom[Passthrough](passThrough=code_block_2, waitFor=setText.success)  # Forces a sequential order of execution. The node wired into the output of the Passthrough node will be executed *after* the node wired into the waitFor input (e.g. important for some Revit operations). The value of the passThrough input will be passed on to the node wired into the output port of the Passthrough node.
end = Revit.Transaction.Transaction.End(passthrough)
saveAs = Custom[Document.SaveAs](filePath=end)  # Saves the active Revit document under the given name.

# group: Terminate Revit
passthrough_2 = Custom[Passthrough](passThrough=terminate_revit_when_done, waitFor=saveAs)
killCurrentProcess = ProcessRunner.Process.KillCurrentProcess(passthrough_2)
