# Dynamo graph ScenarioC_Slave2_LoadAndPlaceFamilies_R2017.dyn (Dynamo 1.0.0.1180)

# group: INPUTS
terminate_revit_when_done = BoolSelector(false)
# note: Example for a slave graph that loads and places families in a project file and saves it under a new name.
# REQUIRED PACKAGES:
# - Clockwork for Dynamo 1.x
# - DynamoAutomation
directory_path_output_directory = Directory("C:\temp\DynamoAutomation\output")
number_slider_spacing = DoubleSlider(4000, range=0..10000 step 100)

# group: Create new path for model
current = Document.Current()
filePath = Document.FilePath(current)
code_block = CodeBlock { ".rvt"; "_altered.rvt"; }
replace = String.Replace(str=filePath, searchFor=code_block.out0, replaceWith=code_block.out1)
directoryName = FilePath.DirectoryName(filePath)
replace_2 = String.Replace(str=replace, searchFor=directoryName, replaceWith=directory_path_output_directory)

# group: Create a list of family files
fromPath = DirectoryObject(directory_path_output_directory)  # "Directory.FromPath"
code_block_2 = CodeBlock { "*altered.rfa"; }
contents = Directory.Contents(fromPath, code_block_2)

# group: Load and place families
loadFamily = Custom[Document.LoadFamily](path=contents)  # A very crude implementation of family loading. Will *not* reload an already loaded family of the same name.
flatten = Flatten(loadFamily)
count = List.Count(contents)
code_block_3 = CodeBlock(spacing=number_slider_spacing, n=count) { 0..spacing..#n; }
byCoordinates = FamilyInstance.ByCoordinates(flatten, code_block_3)

# group: Save modified model under a new name
passthrough = Custom[Passthrough](passThrough=replace_2, waitFor=byCoordinates)  # Forces a sequential order of execution. The node wired into the output of the Passthrough node will be executed *after* the node wired into the waitFor input (e.g. important for some Revit operations). The value of the passThrough input will be passed on to the node wired into the output port of the Passthrough node.
end = Revit.Transaction.Transaction.End(passthrough)
saveAs = Custom[Document.SaveAs](filePath=end)  # Saves the active Revit document under the given name.

# group: Terminte Revit
passthrough_2 = Custom[Passthrough](passThrough=terminate_revit_when_done, waitFor=saveAs)
killCurrentProcess = ProcessRunner.Process.KillCurrentProcess(passthrough_2)
