# Dynamo graph FixWindowOrientation_R2016.dyn (Dynamo 0.9.0.2912)

# group: INPUTS
directory_path_reports = Directory("C:\temp\DynamoAutomation\output")
filename_report_files = StringInput("AutomatedReport")
script_name = StringInput("FixWindowOrientation_R2016.dyn")
# note: Example for a slave graph that updates a model, saves it under a new name and writes individual report files.
categories = Categories("Windows")

# group: Collect data from model and perform action on model
now = DateTime.Now()
current = Document.Current()
filePath = Document.FilePath(current)
all_elements_of_category = ElementsOfCategory(categories)
count = List.Count(all_elements_of_category)
facingOrientation = FamilyInstance.FacingOrientation(all_elements_of_category)
host = Custom[Element.Host](element=all_elements_of_category)  # Gets an element's host
orientation = Custom[Wall.Orientation](wall=host)  # Gets the orientation of a given wall instance (normal of the exterior face of the wall). Will *not* work for walls hosted on mass faces or in-place walls.
isAlmostEqualTo = Vector.IsAlmostEqualTo(facingOrientation, orientation)
filterByBoolMask = List.FilterByBoolMask(list=all_elements_of_category, mask=isAlmostEqualTo)
count_2 = List.Count(filterByBoolMask.out)
flipFacingOrientation = Custom[FamilyInstance.FlipFacingOrientation](familyInstance=filterByBoolMask.out)  # Flips the facing orientation of a given family instance
end = Revit.Transaction.Transaction.End(flipFacingOrientation)
string = StringInput("\")
boolean = BoolSelector(true)
fileName = FilePath.FileName(filePath, boolean)
code_block = CodeBlock { ".rvt"; "_fixed.rvt"; }
replace = String.Replace(str=fileName, searchFor=code_block.out0, replaceWith=code_block.out1)
code_block_2 = CodeBlock(dir=directory_path_reports, delimiter=string, filename=replace) { dir + delimiter + filename; }
code_block_3 = CodeBlock(passthrough=end, path=code_block_2)
# ---------- code_block_3.designscript (2 lines) ----------
// Make sure the model has been changed before saving it...
{passthrough,path}[1];
# ----------------------------------------
saveAs = Custom[Document.SaveAs](filePath=code_block_3)  # Saves the active Revit document under the given name.

# group: Create report content
string_2 = StringInput("\n")
code_block_4 = CodeBlock(path=filePath, scriptname=script_name, now=now, count1=count, count2=count_2)
# ---------- code_block_4.designscript (5 lines) ----------
"Checked Model: " + path;
"Script Name: " + scriptname;
"Timestamp: " + now;
"Windows Counted: " + count1;
"Windows Fixed: " + count2;
# ----------------------------------------
join = String.Join(string_2, code_block_4.out0, code_block_4.out1, code_block_4.out2, code_block_4.out3, code_block_4.out4)

# group: Write report to file
string_3 = StringInput("\")
components = DateTime.Components(now)
create = List.Create(components.out1, components.out2, components.out3, components.out4, components.out5)
code_block_5 = CodeBlock { 2; }
withLeadingZeroes = Custom[List.WithLeadingZeroes](dbl=create, n=code_block_5)  # Adds leading zeros to a sequence of numbers
code_block_6 = CodeBlock(seq=withLeadingZeroes) { seq[0]; seq[1]; seq[2]; seq[3]; seq[4]; }
code_block_7 = CodeBlock(dir=directory_path_reports, delimiter=string_3, filename=filename_report_files, year=components.out0, month=code_block_6.out0, day=code_block_6.out1, hour=code_block_6.out2, min=code_block_6.out3, sec=code_block_6.out4) { dir + delimiter + filename + "_" + year + month + day + "-" + hour + min + sec + ".txt"; }
writeText = File.WriteText(code_block_7, join)
