# Dynamo graph ScenarioC_Slave2_LoadAndPlaceFamilies.dyn (Dynamo 0.9.0.2912)

# group: INPUTS
# note: Example for a slave graph that loads and places families in a project file and saves it under a new name.
# REQUIRED PACKAGES:
# - Clockwork for Dynamo 0.9.x
directory_path_output_directory = Directory("C:\temp\DynamoAutomation\output")
number_slider_spacing = DoubleSlider(4000, range=0..10000 step 100)

# group: Create a list of family files
fromPath = DirectoryObject(directory_path_output_directory)  # "Directory.FromPath"
code_block = CodeBlock { "*altered.rfa"; }
contents = Directory.Contents(fromPath, code_block)

# group: Load and place families
loadFamily = Custom[Document.LoadFamily](path=contents)  # A very crude implementation of family loading. Will *not* reload an already loaded family of the same name.
flatten = Flatten(loadFamily)
count = List.Count(contents)
code_block_2 = CodeBlock(spacing=number_slider_spacing, n=count) { 0..spacing..#n; }
byCoordinates = FamilyInstance.ByCoordinates(flatten, code_block_2)

# group: Create new path for model
current = Document.Current()
filePath = Document.FilePath(current)
code_block_3 = CodeBlock { ".rvt"; "_altered.rvt"; }
replace = String.Replace(str=filePath, searchFor=code_block_3.out0, replaceWith=code_block_3.out1)
directoryName = FilePath.DirectoryName(filePath)
replace_2 = String.Replace(str=replace, searchFor=directoryName, replaceWith=directory_path_output_directory)

# group: Save modified model under a new name
code_block_4 = CodeBlock(passthrough=byCoordinates, path=replace_2) { {passthrough,path}[1]; }
end = Revit.Transaction.Transaction.End(code_block_4)
saveAs = Custom[Document.SaveAs](filePath=end)  # Saves the active Revit document under the given name.
