# Dynamo graph A1 - Sandbox.dyn (Dynamo 0.8.3.2514)

# group: INPUTS
directory_path_revit_models = Directory("C:\Users\adieckmann\Documents\GitHub\DynamoAutomation\revit-models\2016\dir1")
file_path_dynamo_file = Filename("C:\Users\adieckmann\Documents\GitHub\DynamoAutomation\scenarios\Revit\2016\CountWalls.dyn")
revit_version = StringInput("2016")
directory_path_journal_files = Directory("C:\Users\adieckmann\Desktop")
overwrite_existing_journal_files = BoolSelector(true)

# group: Create list of Revit files
fromPath = DirectoryObject(directory_path_revit_models)  # "Directory.FromPath"
code_block = CodeBlock { "*.rvt"; }
contents = Directory.Contents(fromPath, code_block)

# group: Create journal files
byVersion = Custom[RevitAddinsPath.ByVersion](RevitVersion=revit_version)  # Returns the path of Revit Addins folder based on a given Revit version
string = StringInput("\")
count = List.Count(contents)
code_block_2 = CodeBlock(n=count) { 1..n; }
string_from_object = FromObject(code_block_2)
code_block_3 = CodeBlock(jdir=byVersion, delimiter=string, n=string_from_object)
# ---------- code_block_3.designscript (2 lines) ----------
// Create file name for journal file
jdir + delimiter + "DynamoJournalFile_" + n + ".txt";
# ----------------------------------------
byWorkspacePath = Dynamo.Automation.Journal.ByWorkspacePath(contents, file_path_dynamo_file, code_block_3)

# group: Batch-process Revit files
byVersion_2 = Custom[RevitExecutablePath.ByVersion](RevitVersion=revit_version)  # Returns the path of Revit.exe based on a given Revit version
byPathAndArguments = Dynamo.Automation.Process.ByPathAndArguments(byVersion_2)
map = List.Map(list=byWorkspacePath, f_x=byPathAndArguments)

# group: Clean up journal files
fromPath_2 = DirectoryObject(byVersion)  # "Directory.FromPath"
contents_2 = Directory.Contents(fromPath_2)
containsItem = List.ContainsItem(list=code_block_3, item=contents_2)
string_2 = StringInput("journal.[0-9]+.txt")
code_block_4 = CodeBlock(dir=byVersion) { dir + "\\"; }
code_block_5 = CodeBlock { ""; }
replace = String.Replace(str=contents_2, searchFor=code_block_4, replaceWith=code_block_5)
matchRegularExpression = Custom[String.MatchRegularExpression](RegEx=string_2, str=replace)  # Determines if a regular expression matches a string (or a list of strings) and returns a boolean value (or a list, depending on the input). The syntax for regular expressions is explained at http://ironpython-test.readthedocs.org/en/latest/howto/regex.html
code_block_6 = CodeBlock(a=containsItem, b=matchRegularExpression) { {a,b}; }
transpose = List.Transpose(code_block_6)
anyTrue = Custom[List.AnyTrue](seq=transpose)  # Returns true if any item in a list of booleans is true.
filterByBoolMask = List.FilterByBoolMask(list=contents_2, mask=anyTrue)
code_block_7 = CodeBlock(execution_done=map, paths=filterByBoolMask.in)
# ---------- code_block_7.designscript (5 lines) ----------
// We're using this nifty device to ensure that
// moving the files will only happen
// once all the models have been processed
passthrough = {execution_done, paths};
passthrough[1];
# ----------------------------------------
replace_2 = String.Replace(str=filterByBoolMask.in, searchFor=byVersion, replaceWith=directory_path_journal_files)
move = File.Move(code_block_7.out1, replace_2, overwrite_existing_journal_files)
