# Dynamo graph A4 - Sandbox.dyn (Dynamo 0.8.3.2535)

# group: INPUTS
directory_path_journal_files = Directory("C:\Users\adieckmann\Desktop")
overwrite_existing_journal_files = BoolSelector(true)
file_path_file_paths_text_file = Filename("C:\Users\adieckmann\Documents\GitHub\DynamoAutomation\scenarios\A4\File Paths.txt")
file_path_dynamo_file_1 = Filename("C:\Users\adieckmann\Desktop\FamParam.dyn")
file_path_dynamo_file_2 = Filename("C:\Users\adieckmann\Desktop\Home.dyn")
revit_version = StringInput("2016")

# group: Create list of Revit files
fromPath = FileObject(file_path_file_paths_text_file)  # "File.FromPath"
readFromFile = CSV.ReadFromFile(fromPath)
transpose = List.Transpose(readFromFile)
code_block = CodeBlock(seq=transpose)
# ---------- code_block.designscript (6 lines) ----------
// File Paths
seq[0];
// Execute script #1?
seq[1];
// Execute script #2
seq[2];
# ----------------------------------------
exists = File.Exists(code_block.out0)
code_block_2 = CodeBlock(x=code_block.out1, fe=exists, y=code_block.out2)
# ---------- code_block_2.designscript (3 lines) ----------
// Create booleans based on CS file contents
x == 1 && fe;
y == 1 && fe;
# ----------------------------------------
filterByBoolMask = List.FilterByBoolMask(list=code_block.out0, mask=code_block_2.out0)
filterByBoolMask_2 = List.FilterByBoolMask(list=code_block.out0, mask=code_block_2.out1)
join = List.Join(filterByBoolMask.in, filterByBoolMask_2.in)

# group: Create journal files
count = List.Count(filterByBoolMask.in)
ofRepeatedItem = List.OfRepeatedItem(item=file_path_dynamo_file_1, amount=count)
count_2 = List.Count(filterByBoolMask_2.in)
ofRepeatedItem_2 = List.OfRepeatedItem(item=file_path_dynamo_file_2, amount=count_2)
join_2 = List.Join(ofRepeatedItem, ofRepeatedItem_2)
byVersion = Custom[RevitAddinsPath.ByVersion](RevitVersion=revit_version)  # Returns the path of Revit Addins folder based on a given Revit version
string = StringInput("\")
code_block_3 = CodeBlock(a=count, b=count_2) { 1..(a+b); }
string_from_object = FromObject(code_block_3)
code_block_4 = CodeBlock(jdir=byVersion, delimiter=string, n=string_from_object)
# ---------- code_block_4.designscript (2 lines) ----------
// Create file names for journal files
jdir + delimiter + "DynamoJournalFile_" + n + ".txt";
# ----------------------------------------
byWorkspacePath = Dynamo.Automation.Journal.ByWorkspacePath(join, join_2, code_block_4)

# group: Batch-process Revit models
code_block_5 = CodeBlock(jpath=byWorkspacePath)
# ---------- code_block_5.designscript (7 lines) ----------
// You'll need an English language version of Revit
// in order to run the journals.
// If that is your default language
// you won't need this code block.
// This is what needs to appended to the exectuable path for Revit 2016.
// It may be different for Revit 2015.
" /language ENU " + jpath;
# ----------------------------------------
byVersion_2 = Custom[RevitExecutablePath.ByVersion](RevitVersion=revit_version)  # Returns the path of Revit.exe based on a given Revit version
byPathAndArguments = Dynamo.Automation.Process.ByPathAndArguments(byVersion_2)
map = List.Map(list=code_block_5, f_x=byPathAndArguments)
cleanup = Custom[JournalFiles.Cleanup](destinationDirectory=directory_path_journal_files, overwriteExistingFiles=overwrite_existing_journal_files, executionDone=map, generatedJournalFiles=byWorkspacePath)  # Moves all journal files created during a batch-processing operation to a specified directory
