# Dynamo graph Sandbox - Launch Revit with Dynamo - via Dynamo Button.dyn (Dynamo 0.8.1.1473)

revit_version = StringInput("2015")
byVersion = Custom[RevitExecutablePath.ByVersion](RevitVersion=revit_version)  # Returns the path of Revit.exe based on a given Revit version
file_path_revit_file = Filename("C:\Program Files\Autodesk\Revit 2015\Samples\rac_basic_sample_project.rvt")
file_path_dynamo_file = Filename("C:\Users\adieckmann\Desktop\FamParam.dyn")
directory_path_journal_file = Directory("C:\Users\adieckmann\Desktop")
byPaths2 = Custom[RevitJournalFile.ByPaths2](RevitFile=file_path_revit_file, DynamoFile=file_path_dynamo_file, JournalDirectory=directory_path_journal_file)  # Creates a Revit journal file that starts Revit with a given project/family and launches the Dynamo addin with a given Dynamo graph.
# note: Result: "Error on opening document"
# (This is referring to the Revit project file...)
# ... and Revit exits.
run = Custom[ExternalApplication.Run](ExecutablePath=byVersion, Arguments=byPaths2)  # Launches a given external application with the given arguments
